# Grasshopper definition Curve-CSV.gh (Grasshopper 1.0.4)

int = Integer([-1, 0])
panel = Panel("Tabs!")
pt = ConstructPoint(XCoordinate=0, YCoordinate=0, ZCoordinate=0)
panel_2 = Panel("Settings")
panel_3 = Panel("Input")
stock_top = Slider(10, range=0..70)
retract = Slider(20, range=0..70)
z_height = Slider(32, range=0..70)
neg = Negative(Value=z_height)
# Offset for tool bit and cutting depth.
# 
# Seperate internal and external curves
subtraction = Subtraction(A=stock_top, B=z_height)
dom = ConstructDomain(DomainStart=subtraction, DomainEnd=neg)
subtraction_2 = Subtraction(A=retract, B=z_height)
pt_2 = ConstructPoint(XCoordinate=0, YCoordinate=0, ZCoordinate=subtraction_2)
resolution = Slider(3.782, range=0..10)
cutting_depth = Slider(5, range=0..5)
division = Division(A=stock_top, B=cutting_depth)
range = Range(Domain=dom, Steps=division)
pt_3 = ConstructPoint(XCoordinate=0, YCoordinate=0, ZCoordinate=range)
tool_radius = Slider(1.588, range=0..4)
neg_2 = Negative(Value=tool_radius)
float = Number(0.002)
tabs = Slider(4, range=0..12)
tab_size = Slider(1, range=0..12)
external_curves = Curve([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])
offset = Offset(Curve=external_curves, Distance=tool_radius, Plane=PlaneXY(0, 0, 0), Corners=1)
move = Move(Geometry=offset, Motion=pt_3)  # -> Geometry, Transform
simplify = SimplifyTree(Tree=move.Geometry, Front=False)
divdist = DivideDistance(Curve=simplify, Distance=resolution)  # -> Points, Tangents, Parameters
simplify_2 = SimplifyTree(Tree=divdist.Points, Front=False)
lng = ListLength(List=simplify_2)
subtraction_3 = Subtraction(A=lng, B=1)
dom_2 = ConstructDomain(DomainStart=subtraction_3, DomainEnd=0)
range_2 = Range(Domain=dom_2, Steps=tabs)
int_2 = Integer(range_2)
subtraction_4 = Subtraction(A=int_2, B=tab_size)
dom_3 = ConstructDomain(DomainStart=int_2, DomainEnd=subtraction_4)
range_3 = Range(Domain=dom_3, Steps=tab_size)
trim = TrimTree(Tree=range_3, Depth=1)
item = ListItem(List=simplify_2, Index=trim, Wrap=True)
pdecon = Deconstruct(Point=item)  # -> XComponent, YComponent, ZComponent
simplify_3 = SimplifyTree(Tree=trim, Front=False)
pt_4 = ConstructPoint(XCoordinate=pdecon.XComponent, YCoordinate=pdecon.YComponent, ZCoordinate=subtraction)
abs = Absolute(Value=simplify_3)
simplify_4 = SimplifyTree(Tree=pt_4, Front=False)
replace = ReplaceItems(List=simplify_2, Item=simplify_4, Indices=abs, Wrap=False)
trim_2 = TrimTree(Tree=replace, Depth=1)
simplify_5 = SimplifyTree(Tree=trim_2, Front=False)
# Jog to between Jobs
trim_3 = TrimTree(Tree=simplify_5, Depth=1)
item_2 = ListItem(List=trim_3, Index=0, Wrap=True)
pdecon_2 = Deconstruct(Point=item_2)  # -> XComponent, YComponent, ZComponent
pt_5 = ConstructPoint(XCoordinate=pdecon_2.XComponent, YCoordinate=pdecon_2.YComponent, ZCoordinate=subtraction_2)
ins = InsertItems(List=trim_3, Item=pt_5, Indices=int, Wrap=True)
flatten = FlattenTree(Tree=ins, Path="{0}")
internal_curves = Curve()
offset_2 = Offset(Curve=internal_curves, Distance=neg_2, Plane=PlaneXY(0, 0, 0), Corners=1)
move_2 = Move(Geometry=offset_2, Motion=pt_3)  # -> Geometry, Transform
divdist_2 = DivideDistance(Curve=move_2.Geometry, Distance=resolution)  # -> Points, Tangents, Parameters
simplify_6 = SimplifyTree(Tree=divdist_2.Points, Front=False)
lng_2 = ListLength(List=simplify_6)
subtraction_5 = Subtraction(A=lng_2, B=1)
dom_4 = ConstructDomain(DomainStart=subtraction_5, DomainEnd=0)
range_4 = Range(Domain=dom_4, Steps=tabs)
int_3 = Integer(range_4)
subtraction_6 = Subtraction(A=int_3, B=tab_size)
dom_5 = ConstructDomain(DomainStart=int_3, DomainEnd=subtraction_6)
range_5 = Range(Domain=dom_5, Steps=tab_size)
trim_4 = TrimTree(Tree=range_5, Depth=1)
item_3 = ListItem(List=simplify_6, Index=trim_4, Wrap=True)
pdecon_3 = Deconstruct(Point=item_3)  # -> XComponent, YComponent, ZComponent
simplify_7 = SimplifyTree(Tree=trim_4, Front=False)
pt_6 = ConstructPoint(XCoordinate=pdecon_3.XComponent, YCoordinate=pdecon_3.YComponent, ZCoordinate=subtraction)
abs_2 = Absolute(Value=simplify_7)
simplify_8 = SimplifyTree(Tree=pt_6, Front=False)
replace_2 = ReplaceItems(List=simplify_6, Item=simplify_8, Indices=abs_2, Wrap=False)
trim_5 = TrimTree(Tree=replace_2, Depth=1)
simplify_9 = SimplifyTree(Tree=trim_5, Front=False)
trim_6 = TrimTree(Tree=simplify_9, Depth=1)
item_4 = ListItem(List=trim_6, Index=0, Wrap=True)
pdecon_4 = Deconstruct(Point=item_4)  # -> XComponent, YComponent, ZComponent
pt_7 = ConstructPoint(XCoordinate=pdecon_4.XComponent, YCoordinate=pdecon_4.YComponent, ZCoordinate=subtraction_2)
ins_2 = InsertItems(List=trim_6, Item=pt_7, Indices=int, Wrap=True)
flatten_2 = FlattenTree(Tree=ins_2, Path="{0}")
ins_3 = InsertItems(List=flatten, Item=flatten_2, Indices=0, Wrap=True)
# Home to jog height
# 
# jog height to home
ins_4 = InsertItems(List=ins_3, Item=pt_2, Indices=int, Wrap=True)
ins_5 = InsertItems(List=ins_4, Item=pt, Indices=int, Wrap=True)
flatten_3 = FlattenTree(Tree=ins_5, Path="{0}")
null = NullItem(Item=flatten_3)  # -> NullFlags, InvalidFlags, Description
dispatch = Dispatch(List=flatten_3, DispatchPattern=null.NullFlags)  # -> ListA, ListB
division_2 = Division(A=dispatch.ListB, B=float)
# Final list of points
pdecon_5 = Deconstruct(Point=division_2)  # -> XComponent, YComponent, ZComponent
int_4 = Integer(pdecon_5.XComponent)
int_5 = Integer(pdecon_5.YComponent)
int_6 = Integer(pdecon_5.ZComponent)
pt_8 = ConstructPoint(XCoordinate=int_4, YCoordinate=int_5, ZCoordinate=int_6)
multiplication = Multiplication(A=pt_8, B=float)
panel_4 = Panel(multiplication)
pdecon_6 = Deconstruct(Point=multiplication)  # -> XComponent, YComponent, ZComponent
concat = Concatenate(
    FragmentA=pdecon_6.XComponent,
    FragmentB=",",
    FragmentC=pdecon_6.YComponent,
    FragmentD=",",
    FragmentE=pdecon_6.ZComponent)
data = Data(concat)
panel_5 = Panel("Simple Simulator")
timer = Timer(TimerInterval=100, Target=int_7)  # disabled
panel_6 = Panel("Output")
panel_7 = Panel(data)
int_7 = Integer(1)
pline = PolyLine(Vertices=data, Closed=False)
rec = DataRecorder(int_7, DataLimit=-10, RecordData=True)
divdist_3 = DivideDistance(Curve=pline, Distance=Slider(3, range=0..3))  # -> Points, Tangents, Parameters
ma = MassAddition(Input=rec)  # -> Result, PartialResults
simplify_10 = SimplifyTree(Tree=divdist_3.Points, Front=False)
item_5 = ListItem(List=simplify_10, Index=ma.Result, Wrap=True)
panel_8 = Panel(simplify_10)
cyl = Cylinder(Base=item_5, Radius=tool_radius, Length=20)
int_8 = Integer(33)
int_9 = Integer(37)
panel_9 = Panel("CNC Model Simulator")
neg_3 = Negative(Value=int_8)
pt_9 = ConstructPoint(XCoordinate=neg_3, YCoordinate=int_9, ZCoordinate=neg)
int_10 = Integer(110)
int_11 = Integer(100)
neg_4 = Negative(Value=int_10)
neg_5 = Negative(Value=int_11)
panel_10 = Panel("CNC Stages (Mesh)")
pdecon_7 = Deconstruct(Point=item_5)  # -> XComponent, YComponent, ZComponent
Y = Mesh([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])
addition = Addition(A=neg_4, B=pdecon_7.YComponent)
addition_2 = Addition(A=neg_5, B=pdecon_7.XComponent)
bed = Mesh([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])
X = Mesh([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])
Z = Mesh([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])
move_3 = Move(Geometry=bed, Motion=pt_9)  # -> Geometry, Transform
move_4 = Move(Geometry=X, Motion=pt_9)  # -> Geometry, Transform
move_5 = Move(Geometry=Z, Motion=pt_9)  # -> Geometry, Transform
move_6 = Move(Geometry=Y, Motion=pt_9)  # -> Geometry, Transform
pt_10 = ConstructPoint(XCoordinate=0, YCoordinate=addition, ZCoordinate=0)
pt_11 = ConstructPoint(XCoordinate=addition_2, YCoordinate=0, ZCoordinate=0)
pt_12 = ConstructPoint(XCoordinate=0, YCoordinate=0, ZCoordinate=pdecon_7.ZComponent)
move_7 = Move(Geometry=move_6.Geometry, Motion=pt_10)  # -> Geometry, Transform
move_8 = Move(Geometry=move_5.Geometry, Motion=pt_10)  # -> Geometry, Transform
move_9 = Move(Geometry=move_8.Geometry, Motion=pt_11)  # -> Geometry, Transform
move_10 = Move(Geometry=move_9.Geometry, Motion=pt_12)  # -> Geometry, Transform
move_11 = Move(Geometry=move_4.Geometry, Motion=pt_10)  # -> Geometry, Transform
move_12 = Move(Geometry=move_11.Geometry, Motion=pt_11)  # -> Geometry, Transform
