# Grasshopper definition Image-Curve-CSV.gh (Grasshopper 1.0.4)
# plug-ins: Python Interpreter

int = Integer([-1, 0])
int_2 = Integer([-1, 0])
panel = Panel("Tabs!")
Z = UnitZ(Factor=1)
xy = XYPlane(Origin=Point(0, 0, 0))
pt = ConstructPoint(XCoordinate=0, YCoordinate=0, ZCoordinate=0)
panel_2 = Panel("Image Settings:")
x_size = Slider(100, range=0..200)
y_size = Slider(0, range=0..200)
python = PythonScript(x=x_size, y=y_size)  # -> out, a
# ---------- python: Python ----------
__author__ = "james"

import rhinoscriptsyntax as rs

y = float(y)
x= float(x)

if (y==0):
	y=x

else:
	y=y
	x=x


print(y)
# ---------- end python ----------
rectangle = Rectangle(Plane=PlaneXY(0, 0, 0), XSize=x_size, YSize=python.out, Radius=0)  # -> Rectangle, Length
x_res = Slider(171.944, range=0..200)
# Amplitude:
# 
# 0-1 for black and white.
# 
# 0-? for colour. (subject to image)
number_slider = Slider(0.757, range=0..1)
amp = Amplitude(Vector=Z, Amplitude=number_slider)
move = Move(Geometry=xy, Motion=amp)  # -> Geometry, Transform
y_res = Slider(0, range=0..200)
python_2 = PythonScript(x=x_res, y=y_res)  # -> out, a; same code as python
mplane = MeshPlane(Boundary=rectangle.Rectangle, WidthCount=x_res, HeightCount=python_2.out)  # -> Mesh, Area
demesh = DeconstructMesh(Mesh=mplane.Mesh)  # -> Vertices, Faces, Colours, Normals
stock_top = Slider(10, range=0..70)
engrave_depth = Slider(2, range=0..5)
retract = Slider(20, range=0..70)
z_height = Slider(32, range=0..70)
neg = Negative(Value=z_height)
subtraction = Subtraction(A=stock_top, B=z_height)
neg_2 = Negative(Value=z_height)
# Offset for tool bit and cutting depth.
# 
# Seperate internal and external curves
subtraction_2 = Subtraction(A=stock_top, B=z_height)
dom = ConstructDomain(DomainStart=subtraction, DomainEnd=neg)
dom_2 = ConstructDomain(DomainStart=subtraction_2, DomainEnd=neg_2)
subtraction_3 = Subtraction(A=subtraction_2, B=engrave_depth)
subtraction_4 = Subtraction(A=retract, B=z_height)
subtraction_5 = Subtraction(A=retract, B=z_height)
pt_2 = ConstructPoint(XCoordinate=0, YCoordinate=0, ZCoordinate=subtraction_3)
pt_3 = ConstructPoint(XCoordinate=0, YCoordinate=0, ZCoordinate=subtraction_5)
tool_radius = Slider(1.588, range=0..4)
neg_3 = Negative(Value=tool_radius)
neg_4 = Negative(Value=tool_radius)
resolution = Slider(1.965, range=0..10)
cutting_depth = Slider(5, range=0..5)
division = Division(A=stock_top, B=cutting_depth)
division_2 = Division(A=stock_top, B=cutting_depth)
range = Range(Domain=dom, Steps=division)
range_2 = Range(Domain=dom_2, Steps=division_2)
pt_4 = ConstructPoint(XCoordinate=0, YCoordinate=0, ZCoordinate=range)
pt_5 = ConstructPoint(XCoordinate=0, YCoordinate=0, ZCoordinate=range_2)
float = Number(0.002)
tabs = Slider(0, range=0..12)
# Input:
# right click to select curve(s).
tab_size = Slider(1, range=0..12)
panel_3 = Panel("Settings")
single_external_curve = Curve()
offset = Offset(Curve=single_external_curve, Distance=tool_radius, Plane=PlaneXY(0, 0, 0), Corners=1)
move_2 = Move(Geometry=offset, Motion=pt_4)  # -> Geometry, Transform
simplify = SimplifyTree(Tree=move_2.Geometry, Front=False)
divdist = DivideDistance(Curve=simplify, Distance=resolution)  # -> Points, Tangents, Parameters
simplify_2 = SimplifyTree(Tree=divdist.Points, Front=False)
lng = ListLength(List=simplify_2)
subtraction_6 = Subtraction(A=lng, B=1)
dom_3 = ConstructDomain(DomainStart=subtraction_6, DomainEnd=0)
range_3 = Range(Domain=dom_3, Steps=tabs)
int_3 = Integer(range_3)
subtraction_7 = Subtraction(A=int_3, B=tab_size)
dom_4 = ConstructDomain(DomainStart=int_3, DomainEnd=subtraction_7)
range_4 = Range(Domain=dom_4, Steps=tab_size)
trim = TrimTree(Tree=range_4, Depth=1)
item = ListItem(List=simplify_2, Index=trim, Wrap=True)
pdecon = Deconstruct(Point=item)  # -> XComponent, YComponent, ZComponent
simplify_3 = SimplifyTree(Tree=trim, Front=False)
pt_6 = ConstructPoint(XCoordinate=pdecon.XComponent, YCoordinate=pdecon.YComponent, ZCoordinate=subtraction)
abs = Absolute(Value=simplify_3)
simplify_4 = SimplifyTree(Tree=pt_6, Front=False)
replace = ReplaceItems(List=simplify_2, Item=simplify_4, Indices=abs, Wrap=False)
trim_2 = TrimTree(Tree=replace, Depth=1)
item_2 = ListItem(List=trim_2, Index=[-1, 0], Wrap=True)
pdecon_2 = Deconstruct(Point=item_2)  # -> XComponent, YComponent, ZComponent
pt_7 = ConstructPoint(XCoordinate=pdecon_2.XComponent, YCoordinate=pdecon_2.YComponent, ZCoordinate=subtraction_4)
ins = InsertItems(List=trim_2, Item=pt_7, Indices=int, Wrap=True)
flatten = FlattenTree(Tree=ins, Path="{0}")
single_internal_curves = Curve(<curve referenced from the Rhino model>)
offset_2 = Offset(Curve=single_internal_curves, Distance=neg_3, Plane=PlaneXY(0, 0, 0), Corners=1)
move_3 = Move(Geometry=offset_2, Motion=pt_4)  # -> Geometry, Transform
divdist_2 = DivideDistance(Curve=move_3.Geometry, Distance=resolution)  # -> Points, Tangents, Parameters
simplify_5 = SimplifyTree(Tree=divdist_2.Points, Front=False)
lng_2 = ListLength(List=simplify_5)
subtraction_8 = Subtraction(A=lng_2, B=1)
dom_5 = ConstructDomain(DomainStart=subtraction_8, DomainEnd=0)
range_5 = Range(Domain=dom_5, Steps=tabs)
int_4 = Integer(range_5)
subtraction_9 = Subtraction(A=int_4, B=tab_size)
dom_6 = ConstructDomain(DomainStart=int_4, DomainEnd=subtraction_9)
range_6 = Range(Domain=dom_6, Steps=tab_size)
trim_3 = TrimTree(Tree=range_6, Depth=1)
item_3 = ListItem(List=simplify_5, Index=trim_3, Wrap=True)
pdecon_3 = Deconstruct(Point=item_3)  # -> XComponent, YComponent, ZComponent
simplify_6 = SimplifyTree(Tree=trim_3, Front=False)
pt_8 = ConstructPoint(XCoordinate=pdecon_3.XComponent, YCoordinate=pdecon_3.YComponent, ZCoordinate=subtraction)
simplify_7 = SimplifyTree(Tree=pt_8, Front=False)
# Input:
# Right-click to select image, or disable image.
# Double-click to set domain.
engrave = Curve(<curve referenced from the Rhino model>)
move_4 = Move(Geometry=engrave, Motion=pt_2)  # -> Geometry, Transform
divdist_3 = DivideDistance(Curve=move_4.Geometry, Distance=resolution)  # -> Points, Tangents, Parameters
simplify_8 = SimplifyTree(Tree=divdist_3.Points, Front=False)
item_4 = ListItem(List=simplify_8, Index=[0, -1], Wrap=True)
pdecon_4 = Deconstruct(Point=item_4)  # -> XComponent, YComponent, ZComponent
pt_9 = ConstructPoint(XCoordinate=pdecon_4.XComponent, YCoordinate=pdecon_4.YComponent, ZCoordinate=subtraction_2)
ins_2 = InsertItems(List=simplify_8, Item=pt_9, Indices=[0, -1], Wrap=True)
trim_4 = TrimTree(Tree=ins_2, Depth=1)
flatten_2 = FlattenTree(Tree=trim_4, Path="{0}")
item_5 = ListItem(List=flatten_2, Index=[-1, 0], Wrap=True)
pdecon_5 = Deconstruct(Point=item_5)  # -> XComponent, YComponent, ZComponent
pt_10 = ConstructPoint(XCoordinate=pdecon_5.XComponent, YCoordinate=pdecon_5.YComponent, ZCoordinate=subtraction_5)
ins_3 = InsertItems(List=flatten_2, Item=pt_10, Indices=int_2, Wrap=True)
flatten_3 = FlattenTree(Tree=ins_3, Path="{0}")
multiple_internal_curves = Curve(<curve referenced from the Rhino model>)
offset_3 = Offset(Curve=multiple_internal_curves, Distance=neg_4, Plane=PlaneXY(0, 0, 0), Corners=1)
move_5 = Move(Geometry=offset_3, Motion=pt_5)  # -> Geometry, Transform
divdist_4 = DivideDistance(Curve=move_5.Geometry, Distance=resolution)  # -> Points, Tangents, Parameters
simplify_9 = SimplifyTree(Tree=divdist_4.Points, Front=False)
lng_3 = ListLength(List=simplify_9)
subtraction_10 = Subtraction(A=lng_3, B=1)
dom_7 = ConstructDomain(DomainStart=subtraction_10, DomainEnd=0)
range_7 = Range(Domain=dom_7, Steps=tabs)
int_5 = Integer(range_7)
subtraction_11 = Subtraction(A=int_5, B=tab_size)
dom_8 = ConstructDomain(DomainStart=int_5, DomainEnd=subtraction_11)
range_8 = Range(Domain=dom_8, Steps=tab_size)
trim_5 = TrimTree(Tree=range_8, Depth=1)
item_6 = ListItem(List=simplify_9, Index=trim_5, Wrap=True)
pdecon_6 = Deconstruct(Point=item_6)  # -> XComponent, YComponent, ZComponent
simplify_10 = SimplifyTree(Tree=trim_5, Front=False)
pt_11 = ConstructPoint(XCoordinate=pdecon_6.XComponent, YCoordinate=pdecon_6.YComponent, ZCoordinate=subtraction_2)
abs_2 = Absolute(Value=simplify_10)
simplify_11 = SimplifyTree(Tree=pt_11, Front=False)
replace_2 = ReplaceItems(List=simplify_5, Item=simplify_7, Indices=abs_2, Wrap=False)
replace_3 = ReplaceItems(List=simplify_9, Item=simplify_11, Indices=abs_2, Wrap=False)
trim_6 = TrimTree(Tree=replace_2, Depth=1)
trim_7 = TrimTree(Tree=replace_3, Depth=1)
trim_8 = TrimTree(Tree=trim_7, Depth=1)
item_7 = ListItem(List=trim_6, Index=[-1, 0], Wrap=True)
item_8 = ListItem(List=trim_8, Index=[-1, 0], Wrap=True)
pdecon_7 = Deconstruct(Point=item_7)  # -> XComponent, YComponent, ZComponent
pdecon_8 = Deconstruct(Point=item_8)  # -> XComponent, YComponent, ZComponent
pt_12 = ConstructPoint(XCoordinate=pdecon_7.XComponent, YCoordinate=pdecon_7.YComponent, ZCoordinate=subtraction_4)
pt_13 = ConstructPoint(XCoordinate=pdecon_8.XComponent, YCoordinate=pdecon_8.YComponent, ZCoordinate=subtraction_5)
ins_4 = InsertItems(List=trim_6, Item=pt_12, Indices=int, Wrap=True)
ins_5 = InsertItems(List=trim_8, Item=pt_13, Indices=int_2, Wrap=True)
flatten_4 = FlattenTree(Tree=ins_4, Path="{0}")
flatten_5 = FlattenTree(Tree=ins_5, Path="{0}")
multiple_external_curves = Curve()
offset_4 = Offset(Curve=multiple_external_curves, Distance=tool_radius, Plane=PlaneXY(0, 0, 0), Corners=1)
move_6 = Move(Geometry=offset_4, Motion=pt_5)  # -> Geometry, Transform
simplify_12 = SimplifyTree(Tree=move_6.Geometry, Front=False)
divdist_5 = DivideDistance(Curve=simplify_12, Distance=resolution)  # -> Points, Tangents, Parameters
simplify_13 = SimplifyTree(Tree=divdist_5.Points, Front=False)
lng_4 = ListLength(List=simplify_13)
subtraction_12 = Subtraction(A=lng_4, B=1)
dom_9 = ConstructDomain(DomainStart=subtraction_12, DomainEnd=0)
range_9 = Range(Domain=dom_9, Steps=tabs)
int_6 = Integer(range_9)
subtraction_13 = Subtraction(A=int_6, B=tab_size)
dom_10 = ConstructDomain(DomainStart=int_6, DomainEnd=subtraction_13)
range_10 = Range(Domain=dom_10, Steps=tab_size)
trim_9 = TrimTree(Tree=range_10, Depth=1)
item_9 = ListItem(List=simplify_13, Index=trim_9, Wrap=True)
pdecon_9 = Deconstruct(Point=item_9)  # -> XComponent, YComponent, ZComponent
simplify_14 = SimplifyTree(Tree=trim_9, Front=False)
pt_14 = ConstructPoint(XCoordinate=pdecon_9.XComponent, YCoordinate=pdecon_9.YComponent, ZCoordinate=subtraction_2)
abs_3 = Absolute(Value=simplify_14)
simplify_15 = SimplifyTree(Tree=pt_14, Front=False)
replace_4 = ReplaceItems(List=simplify_13, Item=simplify_15, Indices=abs_3, Wrap=False)
trim_10 = TrimTree(Tree=replace_4, Depth=1)
# Jog to between Jobs
trim_11 = TrimTree(Tree=trim_10, Depth=1)
item_10 = ListItem(List=trim_11, Index=[-1, 0], Wrap=True)
pdecon_10 = Deconstruct(Point=item_10)  # -> XComponent, YComponent, ZComponent
pt_15 = ConstructPoint(XCoordinate=pdecon_10.XComponent, YCoordinate=pdecon_10.YComponent, ZCoordinate=subtraction_5)
ins_6 = InsertItems(List=trim_11, Item=pt_15, Indices=int_2, Wrap=True)
flatten_6 = FlattenTree(Tree=ins_6, Path="{0}")
image = ImageSampler(
    demesh.Vertices,
    FilePath="/Users/james/Pictures/garf.png",
    Filter="Value",
    Interpolate=True,
    Umax=100,
    Umin=1,
    Vmax=100,
    Vmin=1,
    Wrap=1)
Z_2 = UnitZ(Factor=image)
move_7 = Move(Geometry=demesh.Vertices, Motion=Z_2)  # -> Geometry, Transform
conmesh = ConstructMesh(Vertices=move_7.Geometry, Faces=demesh.Faces)
sec = MeshPlane(Mesh=conmesh, Plane=move.Geometry)
sift = SiftPattern(List=sec, SiftPattern=[0, 0, 1, 1])  # -> Output0, Output1
null = NullItem(Item=sift.Output0)  # -> NullFlags, InvalidFlags, Description
not = GateNot(A=null.InvalidFlags)
cull = CullPattern(List=sift.Output0, CullPattern=not)
img_crv = Curve(cull)
# Image as curves:
img_crv_2 = Curve(cull)
move_8 = Move(Geometry=img_crv_2, Motion=pt_2)  # -> Geometry, Transform
divdist_6 = DivideDistance(Curve=move_8.Geometry, Distance=resolution)  # -> Points, Tangents, Parameters
simplify_16 = SimplifyTree(Tree=divdist_6.Points, Front=False)
item_11 = ListItem(List=simplify_16, Index=[0, -1], Wrap=True)
pdecon_11 = Deconstruct(Point=item_11)  # -> XComponent, YComponent, ZComponent
pt_16 = ConstructPoint(XCoordinate=pdecon_11.XComponent, YCoordinate=pdecon_11.YComponent, ZCoordinate=subtraction_2)
ins_7 = InsertItems(List=simplify_16, Item=pt_16, Indices=[0, -1], Wrap=True)
trim_12 = TrimTree(Tree=ins_7, Depth=1)
flatten_7 = FlattenTree(Tree=trim_12, Path="{0}")
item_12 = ListItem(List=flatten_7, Index=[-1, 0], Wrap=True)
pdecon_12 = Deconstruct(Point=item_12)  # -> XComponent, YComponent, ZComponent
pt_17 = ConstructPoint(XCoordinate=pdecon_12.XComponent, YCoordinate=pdecon_12.YComponent, ZCoordinate=subtraction_5)
ins_8 = InsertItems(List=flatten_7, Item=pt_17, Indices=int_2, Wrap=True)
flatten_8 = FlattenTree(Tree=ins_8, Path="{0}")
entwine = Entwine(
    Branch00=flatten_8,
    Branch01=flatten_3,
    Branch02=flatten_6,
    Branch03=flatten_5,
    Branch04=flatten,
    Branch05=flatten_4,
    FlattenInputs=True)
flatten_9 = FlattenTree(Tree=entwine, Path="{0}")
# Home to jog height
# 
# jog height to home
ins_9 = InsertItems(List=flatten_9, Item=pt_3, Indices=int_2, Wrap=True)
ins_10 = InsertItems(List=ins_9, Item=pt, Indices=int_2, Wrap=True)
flatten_10 = FlattenTree(Tree=ins_10, Path="{0}")
null_2 = NullItem(Item=flatten_10)  # -> NullFlags, InvalidFlags, Description
dispatch = Dispatch(List=flatten_10, DispatchPattern=null_2.NullFlags)  # -> ListA, ListB
division_3 = Division(A=dispatch.ListB, B=float)
# Final list of points
pdecon_13 = Deconstruct(Point=division_3)  # -> XComponent, YComponent, ZComponent
int_7 = Integer(pdecon_13.XComponent)
int_8 = Integer(pdecon_13.YComponent)
int_9 = Integer(pdecon_13.ZComponent)
pt_18 = ConstructPoint(XCoordinate=int_7, YCoordinate=int_8, ZCoordinate=int_9)
multiplication = Multiplication(A=pt_18, B=float)
panel_4 = Panel(multiplication)
pdecon_14 = Deconstruct(Point=multiplication)  # -> XComponent, YComponent, ZComponent
concat = Concatenate(
    FragmentA=pdecon_14.XComponent,
    FragmentB=",",
    FragmentC=pdecon_14.YComponent,
    FragmentD=",",
    FragmentE=pdecon_14.ZComponent)
data = Data(concat)
panel_5 = Panel("Simple Simulator")
timer = Timer(TimerInterval=100, Target=int_10)  # disabled
# Output:
# Right-click to stream contents.
panel_6 = Panel(data)
int_10 = Integer(1)
pline = PolyLine(Vertices=data, Closed=False)
rec = DataRecorder(int_10, DataLimit=-10, RecordData=True)
divdist_7 = DivideDistance(Curve=pline, Distance=Slider(3, range=0..3))  # -> Points, Tangents, Parameters
ma = MassAddition(Input=rec)  # -> Result, PartialResults
simplify_17 = SimplifyTree(Tree=divdist_7.Points, Front=False)
item_13 = ListItem(List=simplify_17, Index=ma.Result, Wrap=True)
panel_7 = Panel(simplify_17)
cyl = Cylinder(Base=item_13, Radius=tool_radius, Length=20)
int_11 = Integer(33)
int_12 = Integer(37)
panel_8 = Panel("CNC Model Simulator")
neg_5 = Negative(Value=int_11)
pt_19 = ConstructPoint(XCoordinate=neg_5, YCoordinate=int_12, ZCoordinate=neg_2)
int_13 = Integer(110)
int_14 = Integer(100)
neg_6 = Negative(Value=int_13)
neg_7 = Negative(Value=int_14)
panel_9 = Panel("CNC Stages (Mesh)")
pdecon_15 = Deconstruct(Point=item_13)  # -> XComponent, YComponent, ZComponent
Y = Mesh([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])
addition = Addition(A=neg_6, B=pdecon_15.YComponent)
addition_2 = Addition(A=neg_7, B=pdecon_15.XComponent)
bed = Mesh([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])
X = Mesh([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])
Z_3 = Mesh([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])
move_9 = Move(Geometry=bed, Motion=pt_19)  # -> Geometry, Transform
move_10 = Move(Geometry=X, Motion=pt_19)  # -> Geometry, Transform
move_11 = Move(Geometry=Z_3, Motion=pt_19)  # -> Geometry, Transform
move_12 = Move(Geometry=Y, Motion=pt_19)  # -> Geometry, Transform
pt_20 = ConstructPoint(XCoordinate=0, YCoordinate=addition, ZCoordinate=0)
pt_21 = ConstructPoint(XCoordinate=addition_2, YCoordinate=0, ZCoordinate=0)
pt_22 = ConstructPoint(XCoordinate=0, YCoordinate=0, ZCoordinate=pdecon_15.ZComponent)
move_13 = Move(Geometry=move_12.Geometry, Motion=pt_20)  # -> Geometry, Transform
move_14 = Move(Geometry=move_11.Geometry, Motion=pt_20)  # -> Geometry, Transform
move_15 = Move(Geometry=move_14.Geometry, Motion=pt_21)  # -> Geometry, Transform
move_16 = Move(Geometry=move_15.Geometry, Motion=pt_22)  # -> Geometry, Transform
move_17 = Move(Geometry=move_10.Geometry, Motion=pt_20)  # -> Geometry, Transform
move_18 = Move(Geometry=move_17.Geometry, Motion=pt_21)  # -> Geometry, Transform
